# Grasshopper definition Sample2.ghx (Grasshopper 1.0.7)

geometry = Geometry()
push_to_bake = Button()
revit_bake = CSharpScript(
    Geometry=geometry,
    Bake=push_to_bake,
    Reference=["C:\Program Files\Autodesk\Revit 2019\RevitAPIUI.dll", "C:\Program Files\Autodesk\Revit 2019\RevitAPI.dll", "C:\Users\kike.garcia\AppData\Roaming\Autodesk\Revit\Addins\2019\RhinoInside.Revit\RhinoInside.Revit.dll"])  # -> out; inputs Geometry: list of GeometryBase, Bake: Boolean
# ---------- revit_bake: C# ----------
    if(Bake)
      RhinoInside.Revit.BakeGeometry(Geometry);
# ---------- end revit_bake ----------
taskdialog = CSharpScript(
    Caption="Grasshopper",
    Message="Hello Revit!!",
    Reference=["C:\Program Files\Autodesk\Revit 2019\RevitAPI.dll", "C:\Program Files\Autodesk\Revit 2019\RevitAPIUI.dll"])  # -> out, Result; inputs Caption: String, Message: String; disabled
# ---------- taskdialog: C# ----------
    Result = Autodesk.Revit.UI.TaskDialog.Show(Caption, Message);
# ---------- end taskdialog ----------
panel = Panel(taskdialog.Result)
panel_2 = Panel(revit_bake)
